# Grasshopper definition rhino_mesh_exporter.ghx (Grasshopper 1.0.8)

panel = Panel("/Users/arpj/princeton/workshops/jaxfdm-workshop/data/mesh_freeform.json")
panel_2 = Panel("/Users/arpj/princeton/workshops/jaxfdm-workshop/data/mesh_freeform.json")
read = BooleanToggle(False)
export = BooleanToggle(False)
bool = Boolean(read)
txt = Text(panel_2)
txt_2 = Text(panel)
bool_2 = Boolean(export)
mesh = Mesh(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)

# ---- group: Read in a mesh from a JSON file
py3 = Python3Script(read=bool, filepath=txt_2)  # -> out, compas_mesh
# ---------- py3: Python ----------
#r: compas

from compas.datastructures import Mesh

if read:
    compas_mesh = Mesh.from_json(filepath)
    print("Succesffully read a mesh!")
    print(compas_mesh)
# ---------- end py3 ----------
panel_3 = Panel(py3.out)
py3_2 = Python3Script(compas_mesh=py3.compas_mesh)  # -> out, rh_mesh
# ---------- py3_2: Python ----------
import rhinoscriptsyntax as rs


if compas_mesh is not None:
    vertices, faces = compas_mesh.to_vertices_and_faces()
    rh_mesh = rs.AddMesh(vertices, faces)
# ---------- end py3_2 ----------

# ---- group: Export a Rhino mesh as a JSON file
py3_3 = Python3Script(rh_mesh=mesh)  # -> out, compas_mesh
# ---------- py3_3: Python ----------
# r: compas

import rhinoscriptsyntax as rs
from compas.datastructures import Mesh


vertices = rs.MeshVertices(rh_mesh)
faces = rs.MeshFaceVertices(rh_mesh)
compas_mesh = Mesh.from_vertices_and_faces(vertices, faces)

print(compas_mesh)
# ---------- end py3_3 ----------
py3_4 = Python3Script(export=bool_2, compas_mesh=py3_3.compas_mesh, filepath=txt)  # -> out
# ---------- py3_4: Python ----------
if export:
    compas_mesh.to_json(filepath)
    print(f"Save mesh at {filepath}")
# ---------- end py3_4 ----------

# ----
panel_4 = Panel(py3_4)
mesh_2 = Mesh(py3_2.rh_mesh)
